# Dynamo graph Hanger_alignment_for_Pipes.dyn "Hanger alignment for Pipes" (Dynamo 3.4.1.7055)

current = Document.Current()
boolean = BoolSelector(true)
python_script = Python(IN[1]=current, IN[2]=boolean)  # CPython3; unwired: IN[0]
# ---------- python_script.python (162 lines) ----------
"""
Dynamo Python Script node
Revit 2026 / Dynamo (CPython3 / PythonNet3 engine)

PURPOSE
-------
For every Pipe Hanger in a chosen 3D view, set the hanger's
"Elevation from Level" instance parameter equal to its host pipe's
MIDDLE (centerline) elevation from the same level, so the hanger
sits centered on the pipe instead of at the pipe's default offset.

INPUTS
------
IN[0]  : Revit View (the 3D view to scope the hangers to). Use a
         "Select Model Element" node set to a view, or the "Views"
         node, wired into this input.
IN[1]  : Document (use "Document.Current" from a document node, or
         leave wired to the default Document node - not the active
         UIDocument).
IN[2]  : DRY_RUN (bool). True = report only, no changes written.
         False = actually update the parameter.

OUTPUT
------
OUT = report dictionary: processed / updated / skipped / errors,
      each a list of strings (Element Id + reason).

NOTES / ASSUMPTIONS (confirm these match your model before a real run)
------------------------------------------------------------------
- Hangers are Revit "Pipe Hanger" category (OST_PipeHanger) family
  instances that are hosted directly on the pipe (FamilyInstance.Host
  or .SuperComponent resolves to the Pipe). If your hangers are NOT
  hosted on the pipe (e.g. hosted on a face/level with no direct
  Host relationship to the pipe), this script cannot find the pipe
  automatically - tell me how the hanger otherwise references its
  pipe (a parameter? proximity?) and I'll adjust.
- The hanger has an editable instance parameter literally named
  "Elevation from Level". If your family uses a different parameter
  name (e.g. "Offset", "Hanger Elevation"), change PARAM_NAME below.
- Pipe "middle elevation" = average Z of the pipe's location curve
  start and end points, converted to an elevation relative to the
  hanger's reference level (Level parameter on the hanger, falling
  back to the pipe's reference level if the hanger has none).
- Always run with DRY_RUN = True first and check the report before
  committing, especially given the crash you hit on the large-model
  run of the earlier parameter script - test on a small view first.
"""

import clr
clr.AddReference('RevitAPI')
clr.AddReference('RevitServices')
from Autodesk.Revit.DB import (
    FilteredElementCollector, BuiltInCategory, FamilyInstance,
    Transaction, Level, XYZ, LocationCurve
)
from RevitServices.Persistence import DocumentManager
from RevitServices.Transactions import TransactionManager

PARAM_NAME = "Elevation from Level"

view = UnwrapElement(IN[0])
doc = UnwrapElement(IN[1]) if IN[1] is not None else DocumentManager.Instance.CurrentDBDocument
dry_run = IN[2]

report = {"processed": [], "updated": [], "skipped": [], "errors": []}

def get_level_elevation(level_id):
    lvl = doc.GetElement(level_id)
    if lvl is None or not isinstance(lvl, Level):
        return None
    return lvl.Elevation

def get_pipe_mid_z(pipe):
    loc = pipe.Location
    if not isinstance(loc, LocationCurve):
        return None
    curve = loc.Curve
    p0 = curve.GetEndPoint(0)
    p1 = curve.GetEndPoint(1)
    return (p0.Z + p1.Z) / 2.0

def get_host_pipe(hanger):
    host = None
    try:
        host = hanger.Host
    except Exception:
        host = None
    if host is None:
        try:
            host = hanger.SuperComponent
        except Exception:
            host = None
    if host is not None and host.Category is not None \
       and host.Category.Id.IntegerValue == int(BuiltInCategory.OST_PipeCurves):
        return host
    return None

collector = FilteredElementCollector(doc, view.Id) \
    .OfCategory(BuiltInCategory.OST_PipeHanger) \
    .WhereElementIsNotElementType()

hangers = list(collector)
report["processed"] = ["{} total hanger(s) found in view".format(len(hangers))]

if not dry_run:
    TransactionManager.Instance.EnsureInTransaction(doc)

for h in hangers:
    eid = h.Id.IntegerValue
    try:
        pipe = get_host_pipe(h)
        if pipe is None:
            report["skipped"].append("Id {}: no host pipe found".format(eid))
            continue

        mid_z = get_pipe_mid_z(pipe)
        if mid_z is None:
            report["skipped"].append("Id {}: pipe has no location curve".format(eid))
            continue

        # reference level: prefer hanger's own Level, fall back to pipe's
        level_id = h.LevelId
        if level_id is None or level_id.IntegerValue == -1:
            level_id = pipe.ReferenceLevel.Id if pipe.ReferenceLevel else None
        if level_id is None:
            report["skipped"].append("Id {}: no reference level found".format(eid))
            continue

        level_elev = get_level_elevation(level_id)
        if level_elev is None:
            report["skipped"].append("Id {}: could not read level elevation".format(eid))
            continue

        target_elev_from_level = mid_z - level_elev

        param = h.LookupParameter(PARAM_NAME)
        if param is None:
            report["skipped"].append("Id {}: no '{}' parameter on this family".format(eid, PARAM_NAME))
            continue
        if param.IsReadOnly:
            report["skipped"].append("Id {}: '{}' is read-only".format(eid, PARAM_NAME))
            continue

        current = param.AsDouble()
        if abs(current - target_elev_from_level) < 1e-6:
            report["skipped"].append("Id {}: already at target elevation".format(eid))
            continue

        if not dry_run:
            param.Set(target_elev_from_level)

        report["updated"].append(
            "Id {}: {} -> {:.4f} ft (host pipe Id {})".format(
                eid, PARAM_NAME, target_elev_from_level, pipe.Id.IntegerValue))

    except Exception as e:
        report["errors"].append("Id {}: {}".format(eid, str(e)))

if not dry_run:
    TransactionManager.Instance.TransactionTaskDone()

OUT = report
# ----------------------------------------
watch = Watch(python_script)
