# Dynamo graph Dynamo_for_pipe_hanger_alignment.dyn "Dynamo for pipe hanger alignment" (Dynamo 3.4.1.7055)

views = Views("{3D - bim1026KWF}")
python_script = Python(IN[0]=views)  # CPython3; graph output; unwired: IN[1]
# ---------- python_script.python (63 lines) ----------
"""
Dynamo Python3 (PythonNet3 engine) — Revit 2026
Collect elements of a given category that are visible/present within a
SPECIFIC view only (respects that view's crop box, visibility/graphics
overrides, and phase) — instead of collecting from the whole model.

Use this in place of the "Categories + All Elements of Category" nodes at
the start of your graph. Its output feeds into the same filter script
(filter_hangers_exclude_sidewall.py) exactly as before.

INPUTS (IN):
  IN[0] : View element OR string - Either wire in a Revit View element
                 directly (e.g. from Dynamo's "Views" / "Select Model Element"
                 node, or "Views.GetByName"), OR pass the exact view name as
                 a string and this script will look it up for you.
  IN[1] : str (optional) - Built-in category name to collect, as it appears
                 after "OST_" in the Revit API (e.g. "PipeAccessory").
                 Defaults to "PipeAccessory" to match your hanger setup.

OUTPUT (OUT):
  A dictionary: {"elements": [...], "view_name": "...", "count": N}
  Wire OUT["elements"] into the filter script's IN[0], same as before.
"""

import clr
clr.AddReference('RevitServices')
clr.AddReference('RevitAPI')

from RevitServices.Persistence import DocumentManager
from Autodesk.Revit.DB import FilteredElementCollector, BuiltInCategory, View

doc = DocumentManager.Instance.CurrentDBDocument

view_input = UnwrapElement(IN[0])
category_name = IN[1] if len(IN) > 1 and IN[1] else "PipeAccessory"

# Resolve the view: accept either an actual View element, or a name string.
target_view = None
if isinstance(view_input, View):
    target_view = view_input
elif isinstance(view_input, str):
    all_views = FilteredElementCollector(doc).OfClass(View).WhereElementIsNotElementType().ToElements()
    for v in all_views:
        if not v.IsTemplate and v.Name == view_input:
            target_view = v
            break

if target_view is None:
    OUT = {"error": "Could not resolve a view from IN[0]. Check the view name matches exactly, or wire in a View element directly.", "elements": [], "count": 0}
else:
    try:
        bic = getattr(BuiltInCategory, "OST_" + category_name)
    except AttributeError:
        OUT = {"error": "Unknown category name '{}'. Check the exact BuiltInCategory spelling.".format(category_name), "elements": [], "count": 0}
    else:
        collector = FilteredElementCollector(doc, target_view.Id).OfCategory(bic).WhereElementIsNotElementType()
        elements = list(collector.ToElements())

        OUT = {
            "elements": elements,
            "view_name": target_view.Name,
            "count": len(elements)
        }
# ----------------------------------------
code_block = CodeBlock { "elements"; }
valueAtKey = DesignScript.Builtin.Dictionary.ValueAtKey(dictionary=python_script, key=code_block)
code_block_2 = CodeBlock { ["ME_PAC_Chilled Water Rod Support Ins 32 mm_CRS"]; }
python_script_2 = Python(IN[0]=valueAtKey, IN[2]=code_block_2)  # CPython3; unwired: IN[1]
# ---------- python_script_2.python (74 lines) ----------
"""
Dynamo Python3 (PythonNet3 engine) — Revit 2026
Filter hanger family instances down to "real" (rod) hangers, excluding
side-wall hangers, based on FAMILY NAME keyword matching.

Use this as a step BEFORE the align_hanger_rods_to_structure.py script —
wire its OUT into IN[0] of that script.

INPUTS (IN):
  IN[0] : list  - All candidate hanger family instances, from ALL your hanger
                  families combined (e.g. multiple "All Elements of Family Type"
                  nodes fed into a List.Join / List.Flatten before this node).
  IN[1] : list of str (optional) - Keywords that, if found in the family name
                  (case-insensitive), mean EXCLUDE this element.
                  Defaults to ["side wall", "sidewall", "wall hanger"].
  IN[2] : list of str (optional) - Keywords that, if provided, mean the family
                  name must contain AT LEAST ONE of these to be INCLUDED
                  (case-insensitive). Leave empty/unwired to skip this check
                  (i.e. include everything not excluded by IN[1]).
                  Example: ["hanger", "rod"] if all your rod-hanger families
                  have "Hanger" or "Rod" somewhere in the name.

OUTPUT (OUT):
  A dictionary: {"filtered": [...], "excluded": [...], "report": [...]}
  "filtered" is what you wire into the alignment script.
  "excluded" and "report" are so you can sanity-check what got dropped.
"""

import clr
clr.AddReference('RevitAPI')
from Autodesk.Revit.DB import FamilyInstance

candidates = UnwrapElement(IN[0]) if not isinstance(IN[0], list) else UnwrapElement(IN[0])
if not isinstance(candidates, list):
    candidates = [candidates]

exclude_keywords = [k.lower() for k in IN[1]] if len(IN) > 1 and IN[1] else ["side wall", "sidewall", "wall hanger"]
include_keywords = [k.lower() for k in IN[2]] if len(IN) > 2 and IN[2] else []

filtered = []
excluded = []
report = []

for el in candidates:
    try:
        if isinstance(el, FamilyInstance):
            fam_name = el.Symbol.Family.Name
        else:
            # Fallback for non-FamilyInstance elements (shouldn't normally hit this)
            fam_name = el.Name

        fam_name_lower = fam_name.lower()

        is_excluded = any(kw in fam_name_lower for kw in exclude_keywords)
        is_included = True if not include_keywords else any(kw in fam_name_lower for kw in include_keywords)

        if is_excluded or not is_included:
            excluded.append(el)
            reason = "matched exclude keyword" if is_excluded else "did not match include keyword"
            report.append("Element {} | Family '{}' | EXCLUDED ({})".format(el.Id.Value, fam_name, reason))
        else:
            filtered.append(el)
            report.append("Element {} | Family '{}' | INCLUDED".format(el.Id.Value, fam_name))

    except Exception as e:
        excluded.append(el)
        report.append("Element {}: ERROR reading family name - {}".format(el.Id.Value, str(e)))

OUT = {
    "filtered": filtered,
    "excluded": excluded,
    "counts": {"total": len(candidates), "filtered": len(filtered), "excluded": len(excluded)},
    "report": report
}
# ----------------------------------------
code_block_3 = CodeBlock { "filtered"; }
valueAtKey_2 = DesignScript.Builtin.Dictionary.ValueAtKey(dictionary=python_script_2, key=code_block_3)
boolean = BoolSelector(false)
code_block_4 = CodeBlock { ["Support_Height01","Support_Height02"]; }
python_script_3 = Python(IN[0]=valueAtKey_2, IN[1]=boolean, IN[2]=code_block_4)  # CPython3; unwired: IN[3], IN[4], IN[5]
# ---------- python_script_3.python (194 lines) ----------
"""
Dynamo Python3 (PythonNet3 engine) — Revit 2026
Align generic-model hanger rods to the nearest structure above them
(structural framing, structural columns, or floors — whichever is closer).

INPUTS (IN):
  IN[0] : list  - Hanger family instances (e.g. from "All Elements of Family/Category")
  IN[1] : bool  - DRY_RUN. True = report only, no changes written. False = write changes.
  IN[2] : str   - (optional) Name of the instance parameter that stores rod length.
                  Defaults to "Rod Length" if not supplied.
  IN[3] : float - (optional) Max search distance in feet for the upward raycast.
                  Defaults to 50 ft (covers most floor-to-floor heights). Increase
                  for tall/atrium spaces.

OUTPUT (OUT):
  A dictionary with counts + a detailed per-element report list.

CONFIG NOTES:
  - This assumes the hanger's LocationPoint (family origin) is the point the rod
    hangs FROM (i.e. effectively the bottom of the rod / top of the hung service),
    and that the rod parameter is a plain Length parameter driving an extrusion
    or void in the family. If your family instead uses two adaptive points
    (base + top), this script will need a different approach (moving the top
    point rather than setting a length parameter) — let me know and I'll adjust.
  - Uses a single ReferenceIntersector (built once, reused for every hanger) for
    performance on large models — do not recreate it inside the loop.
  - Wrapped in ONE transaction for the whole run rather than per-element, and
    doc.Regenerate() is called only once at the end — this is the fix for the
    freeze/crash pattern you hit before with per-element transactions on a
    large element set.
"""

import clr
clr.AddReference('RevitServices')
clr.AddReference('RevitAPI')
clr.AddReference('RevitNodes')

from RevitServices.Persistence import DocumentManager
from RevitServices.Transactions import TransactionManager
from Autodesk.Revit.DB import (
    FilteredElementCollector, BuiltInCategory, ElementCategoryFilter,
    LogicalOrFilter, XYZ, ReferenceIntersector, FindReferenceTarget,
    Transaction, ElementId
)
import System

doc = DocumentManager.Instance.CurrentDBDocument
uidoc = DocumentManager.Instance.CurrentUIApplication.ActiveUIDocument

# ---------------- CONFIG ----------------
hangers_input = UnwrapElement(IN[0]) if not isinstance(IN[0], list) else UnwrapElement(IN[0])
if not isinstance(hangers_input, list):
    hangers_input = [hangers_input]

DRY_RUN = IN[1]
_rod_param_input = IN[2] if len(IN) > 2 and IN[2] else "Rod Length"
# Accept either a single parameter name (str) or a list of names (for hangers
# with multiple rods, e.g. trapeze hangers with two independent rod params).
# The SAME computed structure distance is applied to every parameter listed.
ROD_PARAM_NAMES = _rod_param_input if isinstance(_rod_param_input, list) else [_rod_param_input]
MAX_SEARCH_FT = IN[3] if len(IN) > 3 and IN[3] else 50.0
# Whether the raycast should also look for structure inside linked Revit models
# (very common for MEP hangers, since structure is usually a separate link).
# Defaults to True. Wire a Boolean into IN[4] if you ever need to turn it off.
SEARCH_LINKED_MODELS = IN[4] if len(IN) > 4 and IN[4] is not None else True
# How far the rod should extend PAST the structure surface (penetration into
# the slab/ceiling/framing), in INCHES. Defaults to 2 in. Wire a number into
# IN[5] to change it. Set to 0 if you want the rod to stop exactly at the
# structure surface instead.
PENETRATION_IN = IN[5] if len(IN) > 5 and IN[5] is not None else 2.0
PENETRATION_FT = PENETRATION_IN / 12.0

TARGET_CATEGORIES = [
    BuiltInCategory.OST_StructuralFraming,
    BuiltInCategory.OST_StructuralColumns,
    BuiltInCategory.OST_Floors,
]
# -----------------------------------------

report = []
elements_would_update = []   # actual Element objects flagged for change (dry run) - use for visual review
elements_updated = []        # actual Element objects that WERE changed (live run)
elements_no_structure = []   # actual Element objects where no structure was found
counts = {
    "total_checked": 0,
    "updated": 0,
    "no_structure_found": 0,
    "no_location_point": 0,
    "param_missing_or_readonly": 0,
    "would_update_dry_run": 0,
    "errors": 0,
}

# Build a single 3D view for the ReferenceIntersector (needs a 3D view, not the active view
# if active view isn't 3D). Falls back to any available 3D view in the document.
view3d = None
collector_views = FilteredElementCollector(doc).OfClass(clr.GetClrType(System.Type.GetType("Autodesk.Revit.DB.View3D, RevitAPI")))
for v in collector_views:
    if not v.IsTemplate:
        view3d = v
        break

if view3d is None:
    IN0 = None
    OUT = {"error": "No non-template 3D view found in the document. Create one 3D view and re-run."}
else:
    # Build category filter (OR across the target categories)
    cat_filters = [ElementCategoryFilter(bic) for bic in TARGET_CATEGORIES]
    combined_filter = cat_filters[0]
    for f in cat_filters[1:]:
        combined_filter = LogicalOrFilter(combined_filter, f)

    ref_intersector = ReferenceIntersector(combined_filter, FindReferenceTarget.Element, view3d)
    ref_intersector.FindReferencesInRevitLinks = SEARCH_LINKED_MODELS

    if not DRY_RUN:
        t = Transaction(doc, "Align hanger rods to structure")
        t.Start()

    for hanger in hangers_input:
        counts["total_checked"] += 1
        try:
            loc = hanger.Location
            if not hasattr(loc, "Point"):
                counts["no_location_point"] += 1
                report.append("Element {}: SKIPPED - no LocationPoint (not a point-based family?)".format(hanger.Id.Value))
                continue

            origin = loc.Point
            direction = XYZ(0, 0, 1)  # straight up

            hits = ref_intersector.Find(origin, direction)
            closest = None
            closest_dist = None
            for hit in hits:
                dist = hit.Proximity
                if dist <= 0 or dist > MAX_SEARCH_FT:
                    continue
                if closest_dist is None or dist < closest_dist:
                    closest_dist = dist
                    closest = hit

            if closest is None:
                counts["no_structure_found"] += 1
                elements_no_structure.append(hanger)
                report.append("Element {}: NO STRUCTURE FOUND within {} ft above".format(hanger.Id.Value, MAX_SEARCH_FT))
                continue

            new_val = closest_dist + PENETRATION_FT
            any_param_updated_this_hanger = False

            for rod_param_name in ROD_PARAM_NAMES:
                param = hanger.LookupParameter(rod_param_name)
                if param is None or param.IsReadOnly:
                    counts["param_missing_or_readonly"] += 1
                    report.append("Element {}: PARAMETER '{}' missing or read-only".format(hanger.Id.Value, rod_param_name))
                    continue

                old_val = param.AsDouble()

                if DRY_RUN:
                    report.append("Element {}: WOULD UPDATE '{}' from {:.3f} ft to {:.3f} ft (structure surface at {:.3f} ft + {:.2f} in penetration)".format(
                        hanger.Id.Value, rod_param_name, old_val, new_val, closest_dist, PENETRATION_IN))
                else:
                    param.Set(new_val)
                    report.append("Element {}: UPDATED '{}' from {:.3f} ft to {:.3f} ft".format(
                        hanger.Id.Value, rod_param_name, old_val, new_val))
                any_param_updated_this_hanger = True

            if any_param_updated_this_hanger:
                if DRY_RUN:
                    counts["would_update_dry_run"] += 1
                    elements_would_update.append(hanger)
                else:
                    counts["updated"] += 1
                    elements_updated.append(hanger)

        except Exception as e:
            counts["errors"] += 1
            report.append("Element {}: ERROR - {}".format(hanger.Id.Value, str(e)))

    if not DRY_RUN:
        doc.Regenerate()
        t.Commit()

    OUT = {
        "summary": counts,
        "dry_run": DRY_RUN,
        "rod_parameter_used": ROD_PARAM_NAMES,
        "report": report,
        "elements_would_update": elements_would_update,
        "elements_updated": elements_updated,
        "elements_no_structure": elements_no_structure
    }
# ----------------------------------------
watch = Watch(python_script_3)
