# Dynamo graph Dynamo for 3D View segregation.dyn (Dynamo 3.4.1.7055)

categories = Categories("OST_RvtLinks")
all_elements_of_category = ElementsOfCategory(Category=categories)
number = DoubleInput(12)
getItemAtIndex = List.GetItemAtIndex(list=all_elements_of_category, index=number)
number_2 = DoubleInput(200)
number_3 = DoubleInput(200)
python_script = Python(IN[0]=getItemAtIndex, IN[1]=number_2, IN[2]=number_3)  # CPython3
# ---------- python_script.python (429 lines) ----------
import clr

# ---------------------------------------------------------
# Revit API
# ---------------------------------------------------------

clr.AddReference("RevitAPI")
from Autodesk.Revit.DB import *

# ---------------------------------------------------------
# Revit Services
# ---------------------------------------------------------

clr.AddReference("RevitServices")
from RevitServices.Persistence import DocumentManager
from RevitServices.Transactions import TransactionManager

doc = DocumentManager.Instance.CurrentDBDocument

# ---------------------------------------------------------
# INPUTS
#
# IN[0] = selected Revit Link Instance
# IN[1] = bottom offset in mm
# IN[2] = top offset in mm
# ---------------------------------------------------------

link_input = IN[0]
bottom_offset_mm = IN[1]
top_offset_mm = IN[2]

# ---------------------------------------------------------
# UNWRAP LINK
# ---------------------------------------------------------

link_instance = UnwrapElement(link_input)

if link_instance is None:
    raise Exception("No RVT link was selected.")

if not isinstance(link_instance, RevitLinkInstance):
    raise Exception(
        "IN[0] must be a Revit Link Instance."
    )

# ---------------------------------------------------------
# LINK DOCUMENT
# ---------------------------------------------------------

link_doc = link_instance.GetLinkDocument()

if link_doc is None:
    raise Exception(
        "The selected RVT link is unloaded. "
        "Load the link before running the script."
    )

# ---------------------------------------------------------
# LINK TRANSFORM
#
# Converts ARC link coordinates into HOST coordinates.
# ---------------------------------------------------------

link_transform = link_instance.GetTotalTransform()

# ---------------------------------------------------------
# CATEGORIES TO EXCLUDE
# ---------------------------------------------------------

excluded_category_names = [
    "OST_Grids",
    "OST_Levels",
    "OST_ReferencePlanes",
    "OST_Cameras",
    "OST_Elev",
    "OST_Sections",
    "OST_Views",
    "OST_Topography",
    "OST_Site",
    "OST_ProjectBasePoint",
    "OST_SharedBasePoint",
    "OST_SunPath",
    "OST_ScopeBoxes",
]

excluded_ids = set()

for name in excluded_category_names:

    bic = getattr(BuiltInCategory, name, None)

    if bic is None:
        continue

    try:
        cat = Category.GetCategory(link_doc, bic)
        if cat is not None:
            excluded_ids.add(cat.Id.IntegerValue)
    except:
        pass

# ---------------------------------------------------------
# FIND LINK ELEMENT BOUNDING BOX
# ---------------------------------------------------------

min_x = None
min_y = None
max_x = None
max_y = None

# ---------------------------------------------------------
# DIAGNOSTIC COUNTERS
# ---------------------------------------------------------

total_scanned = 0
no_category = 0
not_model_type = 0
excluded_hit = 0
bbox_none = 0
bbox_exception = 0
transform_exception = 0
included_count = 0

category_names_seen = {}
bbox_exception_samples = []
transform_exception_samples = []

collector = FilteredElementCollector(link_doc) \
    .WhereElementIsNotElementType()

for element in collector:

    total_scanned += 1

    # -------------------------------------------------------
    # CATEGORY CHECK
    # -------------------------------------------------------

    try:
        category = element.Category
    except:
        no_category += 1
        continue

    if category is None:
        no_category += 1
        continue

    try:
        cat_name = category.Name
    except:
        cat_name = "UNKNOWN"

    category_names_seen[cat_name] = category_names_seen.get(cat_name, 0) + 1

    try:
        cat_type = category.CategoryType
    except:
        not_model_type += 1
        continue

    if cat_type != CategoryType.Model:
        not_model_type += 1
        continue

    try:
        cat_id = category.Id.IntegerValue
    except:
        cat_id = None

    if cat_id in excluded_ids:
        excluded_hit += 1
        continue

    # -------------------------------------------------------
    # BOUNDING BOX RETRIEVAL (isolated so we can see failures)
    # -------------------------------------------------------

    try:
        bbox = element.get_BoundingBox(None)
    except Exception as e:
        bbox_exception += 1
        if len(bbox_exception_samples) < 5:
            bbox_exception_samples.append(cat_name + " | " + str(e))
        continue

    if bbox is None:
        bbox_none += 1
        continue

    # -------------------------------------------------------
    # TRANSFORM (isolated so we can see failures)
    # -------------------------------------------------------

    try:
        p_min = link_transform.OfPoint(bbox.Min)
        p_max = link_transform.OfPoint(bbox.Max)
    except Exception as e:
        transform_exception += 1
        if len(transform_exception_samples) < 5:
            transform_exception_samples.append(cat_name + " | " + str(e))
        continue

    xs = [p_min.X, p_max.X]
    ys = [p_min.Y, p_max.Y]

    local_min_x = min(xs)
    local_max_x = max(xs)
    local_min_y = min(ys)
    local_max_y = max(ys)

    if min_x is None:
        min_x = local_min_x
        max_x = local_max_x
        min_y = local_min_y
        max_y = local_max_y
    else:
        min_x = min(min_x, local_min_x)
        max_x = max(max_x, local_max_x)
        min_y = min(min_y, local_min_y)
        max_y = max(max_y, local_max_y)

    included_count += 1

# ---------------------------------------------------------
# TOP CATEGORY NAMES BY COUNT
# ---------------------------------------------------------

sorted_categories = sorted(
    category_names_seen.items(),
    key=lambda x: -x[1]
)

top_categories_report = []
for name, count in sorted_categories[:15]:
    top_categories_report.append(name + ": " + str(count))

# ---------------------------------------------------------
# CHECK LINK EXTENTS
# ---------------------------------------------------------

if min_x is None:

    OUT = [
        "ERROR: No valid elements found",
        "Total Elements Scanned", total_scanned,
        "No Category", no_category,
        "Not Model CategoryType", not_model_type,
        "Excluded Category Hit", excluded_hit,
        "BBox None", bbox_none,
        "BBox Exception Count", bbox_exception,
        "BBox Exception Samples", bbox_exception_samples,
        "Transform Exception Count", transform_exception,
        "Transform Exception Samples", transform_exception_samples,
        "Included Count", included_count,
        "Top Categories Seen", top_categories_report,
        "Selected Link Name", link_instance.Name
    ]

else:

    # -------------------------------------------------------
    # SMALL XY BUFFER
    # -------------------------------------------------------

    xy_buffer = 500.0 / 304.8

    min_x -= xy_buffer
    min_y -= xy_buffer
    max_x += xy_buffer
    max_y += xy_buffer

    # -------------------------------------------------------
    # OFFSET CONVERSION
    # -------------------------------------------------------

    bottom_offset = float(bottom_offset_mm) / 304.8
    top_offset = float(top_offset_mm) / 304.8

    # -------------------------------------------------------
    # GET ALL LEVELS
    # -------------------------------------------------------

    levels = list(
        FilteredElementCollector(doc)
        .OfClass(Level)
        .WhereElementIsNotElementType()
    )

    levels = sorted(
        levels,
        key=lambda l: l.ProjectElevation
    )

    # -------------------------------------------------------
    # GET 3D VIEW TYPE
    # -------------------------------------------------------

    view_family_type = None

    for vft in FilteredElementCollector(doc).OfClass(ViewFamilyType):

        if vft.ViewFamily == ViewFamily.ThreeDimensional:

            view_family_type = vft
            break

    if view_family_type is None:
        raise Exception(
            "No 3D ViewFamilyType was found."
        )

    # -------------------------------------------------------
    # EXISTING VIEW NAMES
    # -------------------------------------------------------

    existing_names = set()

    for v in FilteredElementCollector(doc).OfClass(View3D):

        try:
            existing_names.add(v.Name)
        except:
            pass

    # -------------------------------------------------------
    # RESULTS
    # -------------------------------------------------------

    created_views = []
    skipped_views = []
    errors = []

    # -------------------------------------------------------
    # TRANSACTION
    # -------------------------------------------------------

    TransactionManager.Instance.EnsureInTransaction(doc)

    try:

        for i in range(len(levels) - 1):

            current_level = levels[i]
            next_level = levels[i + 1]

            try:

                current_z = current_level.ProjectElevation
                next_z = next_level.ProjectElevation

                bottom_z = current_z - bottom_offset
                top_z = next_z + top_offset

                view_name = "3D - " + current_level.Name

                if view_name in existing_names:

                    skipped_views.append([
                        view_name,
                        "Already exists"
                    ])

                    continue

                view = View3D.CreateIsometric(
                    doc,
                    view_family_type.Id
                )

                view.Name = view_name

                box = BoundingBoxXYZ()

                box.Min = XYZ(
                    min_x,
                    min_y,
                    bottom_z
                )

                box.Max = XYZ(
                    max_x,
                    max_y,
                    top_z
                )

                view.SetSectionBox(box)

                created_views.append(view)

                existing_names.add(view_name)

            except Exception as e:

                errors.append([
                    current_level.Name,
                    str(e)
                ])

    finally:

        TransactionManager.Instance.TransactionTaskDone()

    # -------------------------------------------------------
    # OUTPUT
    # -------------------------------------------------------

    OUT = [
        "Created Views",
        created_views,
        "Skipped Views",
        skipped_views,
        "Errors",
        errors,
        "Selected ARC Link",
        link_instance.Name,
        "Building X Min",
        min_x,
        "Building X Max",
        max_x,
        "Building Y Min",
        min_y,
        "Building Y Max",
        max_y,
        "Bottom Offset mm",
        bottom_offset_mm,
        "Top Offset mm",
        top_offset_mm
    ]
# ----------------------------------------
watch = Watch(python_script)
